# Dynamo graph Session_4_Dynamo_Solution.dyn (Dynamo 1.3.2.2480)

code_block = CodeBlock { "Hello"; }
code_block_2 = CodeBlock { "World"; }
python_script = Python(IN[0]=code_block, IN[1]=code_block_2)
# ---------- python_script.python (8 lines) ----------
import clr
clr.AddReference('ProtoGeometry')
from Autodesk.DesignScript.Geometry import *
#The inputs to this node will be stored as a list in the IN variables.
dataEnteringNode = IN

#Assign your output to the OUT variable.
OUT = " ".join(dataEnteringNode)
# ----------------------------------------
watch = Watch(python_script)
number_slider = DoubleSlider(5.24, range=0..100 step 0.1)
number_slider_2 = DoubleSlider(-3.817, range=-4.021..100 step 0.1)
number_slider_3 = DoubleSlider(6.337, range=0..100 step 0.1)
byCoordinates = Point.ByCoordinates(x=number_slider, y=number_slider_2, z=number_slider_3)
number_slider_4 = DoubleSlider(3.7, range=0..12 step 0.1)
integer_slider = IntegerSlider(8, range=3..15 step 1)
python_script_2 = Python(IN[0]=byCoordinates, IN[1]=number_slider_4, IN[2]=integer_slider)
# ---------- python_script_2.python (25 lines) ----------
import clr
clr.AddReference('ProtoGeometry')
from Autodesk.DesignScript.Geometry import *
#The inputs to this node will be stored as a list in the IN variables.
dataEnteringNode = IN

#Assign your output to the OUT variable.
x = IN[0].X
y = IN[0].Y
z = IN[0].Z

R = IN[1]
N = IN[2]

import math

def nGon(centre, radius, n_sides):
    x, y, z = centre
    angles = [2 * math.pi * i / n_sides for i in range(0,int(n_sides))]
    list_of_points = [(x + radius * math.cos(ang), y + radius * math.sin(ang), z) for ang in angles]
    return list_of_points  # ((2.4, 5.5, 3,8),((2.7, 5.4, 3,8),(...))


pts = [Point.ByCoordinates(pt[0],pt[1],pt[2]) for pt in nGon([x, y, z], R, N)]
OUT = PolyCurve.ByPoints(pts, True)
# ----------------------------------------
watch_2 = Watch(python_script_2)
