# Grasshopper definition Session_4_GH_Solution.gh (Grasshopper 0.9.76)
# plug-ins: Python Interpreter

pt = Point(<point referenced from the Rhino model>)
pt_2 = Point(<point referenced from the Rhino model>)

# ----
# RhinoCommon with
#                   Coercion
python = PythonScript(x=pt, y=pt_2)  # -> out, a
# ---------- python: Python ----------
import Rhino.Geometry as rg
import rhinoscriptsyntax as rs
a = rg.Line(rs.coerce3dpoint(x),rs.coerce3dpoint(y))
# ---------- end python ----------

python_2 = PythonScript(x=[Toggle(False), Toggle(True)])  # -> out, a
# ---------- python_2: Python ----------
if x:
    a = "Hello World!"
else:
    a = "Nothing to say."
# ---------- end python_2 ----------

# ----
# RhinoCommon with
#                   Type Hint
python_3 = PythonScript(x=pt, y=pt_2)  # -> out, a; inputs x: Point3d, y: Point3d
# ---------- python_3: Python ----------
import rhinoscriptsyntax as rs
a = rs.AddLine(x,y)
# ---------- end python_3 ----------

# ----
# RhinoScriptSyntax
python_4 = PythonScript(x=pt, y=pt_2)  # -> out, a; inputs x: Point3d, y: Point3d
# ---------- python_4: Python ----------
import Rhino.Geometry as rg
a = rg.Line(x,y)
# ---------- end python_4 ----------

panel = Panel(python_2.a)
pt_3 = Point(Point(2.783630465, 2.667645862, 0))
python_5 = PythonScript(C=pt_3, R=Slider(6.3, range=0..10), N=Slider(7, range=3..15))  # -> out, P
# ---------- python_5: Python ----------
import rhinoscriptsyntax as rs
import math

def nGon(centre, radius, n_sides):
    x, y, z = centre
    angles = [2 * math.pi * i / n_sides for i in range(0,int(n_sides))]
    list_of_points = [(x + radius * math.cos(ang), y + radius * math.sin(ang), z) for ang in angles]
    return list_of_points  # [[2.4, 5.5, 3,8], [2.7, 5.4, 3,8],[...]]

pts = [rs.AddPoint(pt) for pt in nGon(rs.coerce3dpoint(C), R, N)]
closed_pts = pts + [pts[0]]
P = rs.AddPolyline(closed_pts)
# ---------- end python_5 ----------
