# Grasshopper definition Session_4_GH_Exercise.gh (Grasshopper 0.9.76)
# plug-ins: Python Interpreter

# ----
# Right click and 'set
# point' for each of these
# two components.
pt = Point(<point referenced from the Rhino model>)
pt_2 = Point(<point referenced from the Rhino model>)

# ----
# Template for
#                nGon
number_slider = Slider(4.5, range=0..10)
pt_3 = Point(Point(1, 1, 1))
python = PythonScript(C=pt_3, R=number_slider, N=Slider(5, range=0..10))  # -> out, P
# ---------- python: Python ----------
import rhinoscriptsyntax as rs
import math
from myGeom import nGon
#import myGeom # an alternative import
# NB if you get the following error, then you need to make sure that your script
# does not contain a mixture of spaces and tabs in creating the indent
# "unindent does not match any outer indentation level"

# The following function is not needed - instead imported above
#def nGon(centre, radius, n_sides):
#    x, y, z = centre
#    #
#    #
#    return list_of_points  # [[2.4, 5.5, 3,8],[2.7, 5.4, 3,8],[...]]

pts = [rs.AddPoint(pt) for pt in nGon(rs.coerce3dpoint(C), R, N)]
closed_pts = pts + [pts[0]]
P = rs.AddPolyline(closed_pts)
# ---------- end python ----------

# ----
# RhinoCommon with
#                   Coercion
python_2 = PythonScript(x=pt, y=pt_2)  # -> out, a
# ---------- python_2: Python ----------
import Rhino.Geometry as rg
import rhinoscriptsyntax as rs
a = rg.Line(rs.coerce3dpoint(x),rs.coerce3dpoint(y))
# ---------- end python_2 ----------

python_3 = PythonScript(x=[Toggle(False), Toggle(True)])  # -> out, a
# ---------- python_3: Python ----------
if x:
    a = "Hello World!"
else:
    a = "Nothing to say."
# ---------- end python_3 ----------

# ----
# RhinoCommon with
#                   Type Hint
python_4 = PythonScript(x=pt, y=pt_2)  # -> out, a; inputs x: Point3d, y: Point3d
# ---------- python_4: Python ----------
import rhinoscriptsyntax as rs
a = rs.AddLine(x,y)
# ---------- end python_4 ----------

# ----
# RhinoScriptSyntax
python_5 = PythonScript(x=pt, y=pt_2)  # -> out, a; inputs x: Point3d, y: Point3d
# ---------- python_5: Python ----------
import Rhino.Geometry as rg
a = rg.Line(x,y)
# ---------- end python_5 ----------

panel = Panel(python_3.a)
